# Grasshopper definition runner.gh (Grasshopper 1.0.8)
# plug-ins: Assertive Possum

# ---- group: Test File Path
# Set this to an individual Grasshopper file or a
# directory of GH definitions that implement
# Assertive Possum assert components. For
# example, you can set it to the "tests" directory
# next to this definition. Some tests will fail - this is
# intended for demo purposes :)
path = FilePath()

# ----
# The Rhino.Compute instance can be local
# or remote. Needless to say, it needs to have
# Assertive Possum and any other plugins you
# are using in your tests installed.
rhino_cmpute_url = Panel("http://localhost:5000")

run_unit_tests = BooleanToggle(False)
run = TestRunner(Source=path, Server=rhino_cmpute_url, Run=run_unit_tests)  # -> Reports, Summary, AllPassed
view = ReportViewer(Report=run.Reports)  # -> Passed, Failed, Errors
passed = Panel(view.Passed)
failed = Panel(view.Failed)
# * ERROR means that the Assert component
# itself encuntered a problem and errored out.
# This is different from a FAILED result, which
# means that test output did not match the
# expected value.
error = Panel(view.Errors)
