# Grasshopper definition assert-equal-not-equal-examples.gh (Grasshopper 1.0.8)
# plug-ins: Assertive Possum

# * integer value computed somewhere in
#   your definition
actual = Slider(100, range=0..100)
# Assert Equal / Not Equal
# Check whether two values in your script
# are equal to each other
test_name = Panel("assert-equal-integer")
# * what you expect the value to be
expected = Slider(100, range=0..100)
test_name_2 = Panel("assert-equal-string")
test_name_3 = Panel("assert-not-equal-string")
# * string value computed somewhere in
#   your definition
actual_2 = Panel("hello")
# * what you expect the value to be
expected_2 = Panel("hi")
# * string value computed somewhere in
#   your definition
actual_3 = Panel("hello")
# * what you expect the value NOT to be
expected_3 = Panel("hi")

# ---- group: EQUAL
# * actal is different from expected,
#   this test should succeed
aeq = AssertEqual(Name=test_name, Actual=actual, Expected=expected, Tolerance=1e-06)

# * actal is different from expected,
#   this test should fail
aeq_2 = AssertEqual(Name=test_name_2, Actual=actual_2, Expected=expected_2, Tolerance=1e-06)

# ---- group: NOT EQUAL
# * actal is different from expected,
#   this test should succeed
aneq = AssertNotEqual(Name=test_name_3, Actual=actual_3, Expected=expected_3, Tolerance=1e-06)

# ----
test_result_to_json = TestResultToJSON(Result=aeq)
test_result_to_json_2 = TestResultToJSON(Result=aeq_2)
test_result_to_json_3 = TestResultToJSON(Result=aneq)
# * uniquely named Hops / Rhino.Compute output
context_print = ContextPrint(AssertEqualInteger=test_result_to_json)
# * uniquely named Hops / Rhino.Compute output
context_print_2 = ContextPrint(AssertEqualString=test_result_to_json_2)
# * uniquely named Hops / Rhino.Compute output
context_print_3 = ContextPrint(AssertNotEqualString=test_result_to_json_3)
