# Grasshopper definition assert-geometry-valid-examples.gh (Grasshopper 1.0.8)
# plug-ins: Assertive Possum

# Assert Geometry Valid
# Check to see if your script outputs
# valid geometry
test_name = Panel("assert-valid-mesh-1")
test_name_2 = Panel("assert-valid-mesh-2")
test_name_3 = Panel("assert-valid-curve")

# ---- group: Valid Mesh
mesh = Mesh(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)

# ---- group: Invalid Mesh
mesh_2 = Mesh(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)

# ---- group: Valid Curve
crv = Curve(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)

# ----
# * mesh is valid, so this test should succeed
ageo = AssertGeometryValid(Name=test_name, Geometry=mesh)
# * mesh is invalid, so this test should fail
ageo_2 = AssertGeometryValid(Name=test_name_2, Geometry=mesh_2)
# * urve is valid, so this test should succeed
ageo_3 = AssertGeometryValid(Name=test_name_3, Geometry=crv)
test_result_to_json = TestResultToJSON(Result=ageo)
test_result_to_json_2 = TestResultToJSON(Result=ageo_2)
test_result_to_json_3 = TestResultToJSON(Result=ageo_3)
# * uniquely named Hops / Rhino.Compute output
context_print = ContextPrint(AssertValidMesh1=test_result_to_json)
# * uniquely named Hops / Rhino.Compute output
context_print_2 = ContextPrint(AssertValidMesh2=test_result_to_json_2)
# * uniquely named Hops / Rhino.Compute output
context_print_3 = ContextPrint(AssertValidCurve=test_result_to_json_3)
