# Grasshopper definition assert-null-examples.gh (Grasshopper 1.0.8)
# plug-ins: RhinoCodePluginGH, Assertive Possum

# Assert Null / Not Null
# Check whether a value is null
test_name = Panel("assert-value-is-null")
test_name_2 = Panel("assert-value-is-not-null")

# ---- group: No Data
py3 = Python3Script()  # -> null
# ---------- py3: Python ----------
null = None
# ---------- end py3 ----------

# ---- group: Some Data
py3_2 = Python3Script()  # -> something
# ---------- py3_2: Python ----------
something = 1
# ---------- end py3_2 ----------

# ----
# * the branch is empty,
#   so this test should succeed
anul = AssertNull(Name=test_name, Value=py3)
# * the branch is not empty,
#   so this test should succeed
annl = AssertNotNull(Name=test_name_2, Value=py3_2)
test_result_to_json = TestResultToJSON(Result=anul)
test_result_to_json_2 = TestResultToJSON(Result=annl)
# * uniquely named Hops / Rhino.Compute output
context_print = ContextPrint(AssertValueIsNull=test_result_to_json)
# * uniquely named Hops / Rhino.Compute output
context_print_2 = ContextPrint(AssertValueIsNotNull=test_result_to_json_2)
