# Grasshopper definition assert-true-false-examples.gh (Grasshopper 1.0.8)
# plug-ins: Assertive Possum

# Assert True / False
# Check whether some value in your script
# evaluates to True or False
test_name = Panel("assert-false-simple")
test_name_2 = Panel("assert-true-simple")
test_name_3 = Panel("assert-true-fail")
# * boolean value computed
#   somewhere in your script
actual_value = BooleanToggle(False)
# * boolean value computed
#   somewhere in your script
actual_value_2 = BooleanToggle(True)
# * boolean value computed
#   somewhere in your script
actual_value_3 = BooleanToggle(False)
# * expects False
afls = AssertFalse(Name=test_name, Value=actual_value)
# * expects True
atru = AssertTrue(Name=test_name_2, Value=actual_value_2)
# * expects True and
#   will, therefore, fail
atru_2 = AssertTrue(Name=test_name_3, Value=actual_value_3)
test_result_to_json = TestResultToJSON(Result=afls)
test_result_to_json_2 = TestResultToJSON(Result=atru)
test_result_to_json_3 = TestResultToJSON(Result=atru_2)
# * uniquely named Hops / Rhino.Compute output
context_print = ContextPrint(AssertFalseSimple=test_result_to_json)
# * uniquely named Hops / Rhino.Compute output
context_print_2 = ContextPrint(AssertTrueSimple=test_result_to_json_2)
# * uniquely named Hops / Rhino.Compute output
context_print_3 = ContextPrint(AssertTrueFail=test_result_to_json_3)
